# Grasshopper definition 3d1.gh (Grasshopper 1.0.7)

number_slider = Slider(37, range=0..100)
rectangle = Rectangle(Plane=PlaneXY(0, 0, 0), XSize=number_slider, YSize=number_slider, Radius=0)  # -> Rectangle, Length
pop2d = Populate2D(Region=rectangle.Rectangle, Count=Slider(44, range=0..100), Seed=1)
voronoi = Voronoi(Points=pop2d, Radius=Slider(10, range=0..10), Boundary=rectangle.Rectangle, BruteForceOverride=False)
offset = OffsetCurve(Curve=voronoi, Distance=Slider(1.2, range=-1..3), Corners=1)
Z = UnitZ(Factor=Slider(42, range=0..100))
extr = Extrude(Base=[rectangle.Rectangle, offset], Direction=Z)
preview = CustomPreview(
    Geometry=extr,
    Material={diffuse=RGB(221, 160, 221), emission=RGB(66, 48, 66), shine=0.5, specular=RGB(255, 255, 255), transparency=0})
