# Grasshopper definition 3d2.gh (Grasshopper 1.0.7)
# plug-ins: LunchBox

number_slider = Slider(37, range=0..100)
rectangle = Rectangle(Plane=PlaneXY(0, 0, 0), XSize=number_slider, YSize=number_slider, Radius=0)  # -> Rectangle, Length
hex = HexagonalStructure(
    Surface=rectangle.Rectangle,
    UDivisions=Slider(22, range=0..100),
    VDivisions=Slider(12, range=0..100),
    AdjustShape=0.3,
    Type=Toggle(False))  # -> StructureLines, StructureNodes
Z = UnitZ(Factor=Slider(50, range=0..100))
extr = Extrude(Base=[hex.StructureLines, rectangle.Rectangle], Direction=Z)
preview = CustomPreview(
    Geometry=extr,
    Material={diffuse=RGB(221, 160, 221), emission=RGB(66, 48, 66), shine=0.5, specular=RGB(255, 255, 255), transparency=0})
