# Grasshopper definition patternnew.gh (Grasshopper 1.0.7)
# plug-ins: LunchBox

rectangle = Rectangle(Plane=PlaneXY(0, 0, 0), XSize=Slider(52, range=0..100), YSize=Slider(73, range=0..100), Radius=0)  # -> Rectangle, Length
boundary = BoundarySurfaces(Edges=rectangle.Rectangle)
qgrid = QuadGrid(Surface=boundary, UDivisions=Slider(14, range=0..30), VDivisions=Slider(30, range=0..30))  # -> CornerPoint1, CornerPoint2, CornerPoint3, CornerPoint4, MidPoint, Normals
rectangle_2 = Rectangle(Plane=PlaneXY(0, 0, 0), XSize=Slider(3, range=-1..10), YSize=Slider(1, range=0..10), Radius=Slider(2.1, range=0..3))  # -> Rectangle, Length
rectangle_3 = Rectangle(Plane=PlaneXY(0, 0, 0), XSize=Slider(3, range=-1..10), YSize=Slider(1, range=0..10), Radius=Slider(2.1, range=0..3))  # -> Rectangle, Length
crv = Curve(<curve referenced from the Rhino model>)
crv_2 = Curve(<curve referenced from the Rhino model>)
offset = OffsetCurve(Curve=crv, Distance=Slider(-0.7, range=-2..2), Corners=Slider(1, range=0..4))
offset_2 = OffsetCurve(Curve=crv_2, Distance=Slider(-0.7, range=-2..2), Corners=Slider(4, range=0..4))
move = Move(Geometry=offset, Motion=[qgrid.MidPoint, qgrid.CornerPoint3])  # -> Geometry, Transform
move_2 = Move(Geometry=offset_2, Motion=Vector(0, 0, 10))  # -> Geometry, Transform
polygon = Polygon(
    Plane=PlaneXY(0, 0, 0),
    Radius=Slider(1.7, range=0..10),
    Segments=Slider(4, range=0..10),
    FilletRadius=Slider(0.4, range=0..1))  # -> Polygon, Length
