# Grasshopper definition ring1.gh (Grasshopper 1.0.7)
# plug-ins: LunchBox, Kangaroo2 Components

cyl = Cylinder(Base=PlaneXY(0, 0, 0), Radius=Slider(16, range=0..30), Length=Slider(7, range=2..10))
unroll = UnrollBrep(Brep=cyl, JoinUnrolled=False)
popgeo = PopulateGeometry(Geometry=unroll, Count=Slider(43, range=0..100), Seed=1)
voronoi = Voronoi(Points=popgeo, Radius=Slider(14, range=0..20), BruteForceOverride=False)
mp = MultiPipe(
    Curves=voronoi,
    NodeSize=Slider(1.4, range=0..3),
    EndOffset=1,
    StrutSize=Slider(0.8, range=0..3),
    Segment=0,
    KinkAngle=0.6,
    CubeFit=0,
    Caps=0)
bbox = BoundingBox(Content=mp, Plane=PlaneXY(0, 0, 0))  # -> Box, Box_2
dom = ConstructDomain(DomainStart=0, DomainEnd=Slider(7, range=0..7))
dom_2 = ConstructDomain(DomainStart=0, DomainEnd=Slider(7, range=0..10))
dom_3 = ConstructDomain(DomainStart=0, DomainEnd=Slider(1, range=0..10))
srfmorph = SurfaceMorph(Geometry=mp, Reference=bbox.Box, Surface=cyl, UDomain=dom, VDomain=dom_2, WDomain=dom_3)
preview = CustomPreview(
    Geometry=srfmorph,
    Material={diffuse=RGB(221, 160, 221), emission=RGB(66, 48, 66), shine=0.5, specular=RGB(255, 255, 255), transparency=0})
