# Grasshopper definition ring2.gh (Grasshopper 1.0.7)
# plug-ins: LunchBox, Kangaroo2 Components

cyl = Cylinder(Base=PlaneXY(0, 0, 0), Radius=Slider(13, range=0..50), Length=Slider(10, range=0..10))
unroll = UnrollBrep(Brep=cyl, JoinUnrolled=False)
crv = Curve(<curve referenced from the Rhino model>)
divide = DivideCurve(Curve=crv, Count=Slider(2, range=0..10), Kinks=False)  # -> Points, Tangents, Parameters
qgrid = QuadGrid(UDivisions=Slider(2, range=-1..10), VDivisions=Slider(3, range=0..100))  # -> CornerPoint1, CornerPoint2, CornerPoint3, CornerPoint4, MidPoint, Normals
dom = ConstructDomain(DomainStart=0, DomainEnd=Slider(4, range=0..10))
dispatch = Dispatch(DispatchPattern=[True, False])  # -> ListA, ListB
attract = Attractor(AttractorPoints=divide.Points, TargetPoints=dispatch.ListA, AttractorDomain=dom)  # -> Values, Vectors, Distances
hex = HexagonalStructure(
    Surface=unroll,
    UDivisions=Slider(50, range=0..50),
    VDivisions=Slider(6, range=0..15),
    AdjustShape=0.3,
    Type=Toggle(True))  # -> StructureLines, StructureNodes
dom_2 = ConstructDomain(DomainStart=Slider(10, range=0..10), DomainEnd=1)
dom_3 = ConstructDomain(DomainStart=Slider(2, range=0..10), DomainEnd=1)
dom_4 = ConstructDomain(DomainStart=Slider(7.6, range=0..10), DomainEnd=1)
mp = MultiPipe(
    Curves=hex.StructureLines,
    NodeSize=Slider(0.4, range=0..2),
    EndOffset=1,
    StrutSize=1,
    Segment=0,
    KinkAngle=0.6,
    CubeFit=0,
    Caps=Slider(1, range=0..2))
srfmorph = SurfaceMorph(Geometry=mp, Reference=mp, Surface=cyl, UDomain=dom_4, VDomain=dom_2, WDomain=dom_3)
